# Grasshopper definition Grasshopper definition.gh (Grasshopper 0.9.76)
# plug-ins: Heteroptera, MarchingCubes, FlowLines Components

# ---- group: namayeshgah
point = Point([<point referenced from the Rhino model> x21])

# ---- group: amoozeshi
point_2 = Point([<point referenced from the Rhino model> x3])

# ---- group: edari
point_3 = Point([<point referenced from the Rhino model> x2])

# ---- group: omoomi khadamati
point_4 = Point([<point referenced from the Rhino model> x3])

# ----
list_length = ListLength(List=point)
list_length_2 = ListLength(List=point_2)
list_length_3 = ListLength(List=point_4)
list_length_4 = ListLength(List=point_3)
gene_pool = GenePool(Decimals=2, Maximum=1.3, Minimum=-1.3, Value=[1.3, -1.3, -0.806, 0.9945])
gene_pool_2 = GenePool(Decimals=2, Maximum=1, Minimum=-1, Value=[-1, 1, -1, 1])
gene_pool_3 = GenePool(Decimals=2, Maximum=0.8, Minimum=-0.8, Value=[0.8, -0.8, -0.8, 0.8])
repeat_data = RepeatData(Data=gene_pool, Length=list_length)
repeat_data_2 = RepeatData(Data=gene_pool_2, Length=list_length_2)
repeat_data_3 = RepeatData(Data=gene_pool_3, Length=list_length_3)
repeat_data_4 = RepeatData(Data=Slider(0, range=0..100), Length=list_length_4)
merge = Merge(Data1=repeat_data, Data2=repeat_data_2, Data3=repeat_data_3, Data4=repeat_data_4)

gene_pool_4 = GenePool(Decimals=0, Maximum=35, Minimum=2, Value=[4, 12, 20, 16])
list_length_5 = ListLength(List=point)
list_length_6 = ListLength(List=point_2)
list_length_7 = ListLength(List=point_4)
list_length_8 = ListLength(List=point_3)
merge_2 = Merge(Data1=list_length_5, Data2=list_length_6, Data3=list_length_7, Data4=list_length_8)  # -> graft(Result)
repeat_data_5 = RepeatData(Data=gene_pool_4, Length=merge_2)  # -> flatten(Data)

merge_3 = Merge(Data1=point, Data2=point_2, Data3=point_4, Data4=point_3)
number_slider = Slider(2, range=0..10)
number_slider_2 = Slider(25, range=0..100)
curve = Curve(<curve referenced from the Rhino model>)
circle = Circle(Plane=merge_3, Radius=repeat_data_5)
divide_curve = DivideCurve(Curve=circle, Count=number_slider_2, Kinks=False)  # -> flatten(Points), Tangents, Parameters
rectangle_grid = RectangleGrid(Rectangle=curve, Size=Slider(20, range=0..110), FitSize=True)  # -> flatten(Points), U, V
panel = Panel(merge)
equi2d = Equi2D(
    PointCharges=merge_3,
    PointChargeValues=merge,
    StartPoints=rectangle_grid.Points,
    Damping=4,
    Iteration=Slider(1000, range=0..1000),
    StepSize=1)
construct_domain = ConstructDomain(DomainStart=0, DomainEnd=Slider(13.3, range=0..100))
number_slider_3 = Slider(100, range=0..100)
range = Range(Domain=Domain(0, 1), Steps=expr("x-1", number_slider_3))
graph_mapper = GraphMapper(range, x0=0, x1=1, y0=0, y1=1, container_name="Gaussian", factor=0.3290785551, mean=0.8653210402, sdev=0.09201270342)
bounds = Bounds(Numbers=graph_mapper)
remap_numbers = RemapNumbers(Value=graph_mapper, Source=bounds, Target=construct_domain)  # -> Mapped, Clipped
unit_z = UnitZ(Factor=remap_numbers.Mapped)  # -> reverse(UnitVector)

list_length_9 = ListLength(List=point)
list_length_10 = ListLength(List=point_2)
list_length_11 = ListLength(List=point_4)
list_length_12 = ListLength(List=point_3)

addition = Addition(A=list_length_9, B=list_length_10, C=list_length_11, D=list_length_12)

repeat_data_6 = RepeatData(Data=Slider(0.25, range=0..1), Length=addition)  # -> flatten(Data)

streamlines2dvortex = StreamLines2DVortex(
    PointCharges=merge_3,
    PointChargeValues=repeat_data_6,
    VortexValues=merge,
    StartPoints=divide_curve.Points,
    Damping=4,
    Iteration=Slider(500, range=0..1000),
    StepSize=Slider(0.25, range=0..1))
custom_preview = CustomPreview(Geometry=streamlines2dvortex, Shader=ColourSwatch(SwatchColor=RGB(255, 255, 255)))
streamlines2d = StreamLines2D(
    PointCharges=merge_3,
    PointChargeValues=repeat_data_6,
    StartPoints=divide_curve.Points,
    Damping=4,
    Iteration=100,
    StepSize=1)
divide_curve_2 = DivideCurve(Curve=streamlines2dvortex, Count=number_slider_3, Kinks=False)  # -> Points, Tangents, Parameters
move = Move(Geometry=divide_curve_2.Points, Motion=unit_z)  # -> Geometry, Transform
interpolate = Interpolate(Vertices=move.Geometry, Degree=3, Periodic=False, KnotStyle=0)  # -> flatten(Curve), Length, Domain
curve_2 = Curve(simplify(graft(interpolate.Curve)))
curve_3 = Curve(simplify(graft(streamlines2dvortex)))
partition_list = PartitionList(List=interpolate.Curve, Size=number_slider_2)
curve_4 = Curve([curve_3, curve_2])
tree_statistics = TreeStatistics(Tree=partition_list)  # -> Paths, Length, Count
loft = Loft(Curves=curve_4, Options={Adjust=False, Closed=False, LoftEnds=0, LoftSimp=0, LoftType=0, Rebuild=10, Refit=0.01})  # disabled
list_item = ListItem(List=tree_statistics.Paths, Index=Slider(0, range=0..10), Wrap=True)
tree_branch = TreeBranch(Tree=partition_list, Path=list_item, MaintainPaths=True)

# ---- group: cocon
curve_5 = Curve(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)
curve_6 = Curve(<curve referenced from the Rhino model>)
curve_charge = CurveCharge(Curve=tree_branch, Radius=Slider(1.5, range=0..70), ChargeStrengths=Slider(4.3, range=0..100))  # disabled
number_slider_4 = Slider(0.5, range=0..70)  # disabled
number_slider_5 = Slider(0.1, range=0..1)  # disabled
number_slider_6 = Slider(0.79, range=0..10)  # disabled
boolean_toggle = BooleanToggle(True)  # disabled
cocoon = Cocoon(Charges=curve_charge, Iso=number_slider_6, CellSize=number_slider_4, Execute=boolean_toggle, Simple=False)  # -> Mesh, RefinementData; disabled
number_slider_7 = Slider(2, range=0..10)  # disabled
number_slider_8 = Slider(3, range=0..10)  # disabled
number_slider_9 = Slider(0.1, range=0..1)  # disabled
number_slider_10 = Slider(0.2, range=0..1)  # disabled
number_slider_11 = Slider(2.5, range=0..10)  # disabled
number_slider_12 = Slider(3, range=0..10)  # disabled
boolean_toggle_2 = BooleanToggle(True)  # disabled
refine = Refine(
    RefinementData=cocoon.RefinementData,
    Samples=number_slider_12,
    SampleSize=number_slider_9,
    SampleTolerance=number_slider_10,
    LaplacianSmoothing=number_slider_11,
    ValencePasses=number_slider_8,
    SubD=number_slider_7,
    Execute=boolean_toggle_2)  # disabled
